# Grasshopper definition box.gh (Grasshopper 0.9.76)
# plug-ins: Python Interpreter

# ---- group: get path to input file
python = PythonScript()  # -> path
# ---------- python: Python ----------
path = ghenv.Component.OnPingDocument().FilePath
path = path.split("\\")
path = "\\".join(path[:-1] + ["inputs.txt"])
# ---------- end python ----------

# ----
file = ReadFile(File=python, PerLineParse=True)
bang = ExplodeTree(Data=simplify(graft(file)))  # -> Branch0, Branch1, Branch2
pt = ConstructPoint(XCoordinate=0, YCoordinate=0, ZCoordinate=0)
pt_2 = ConstructPoint(XCoordinate=bang.Branch0, YCoordinate=bang.Branch1, ZCoordinate=bang.Branch2)
box = Box2Pt(PointA=pt, PointB=pt_2, Plane=PlaneXY(0, 0, 0))
geo = Geometry(box)
area = Area(Geometry=geo)  # -> Area, Centroid
volume = Volume(Geometry=geo)  # -> Volume, Centroid
merge = Merge(Data1=area.Area, Data2=volume.Volume)

# ---- group: write to output file
python_2 = PythonScript(data=merge, screenshot=Toggle(True))  # -> out; inputs data: list
# ---------- python_2: Python ----------
import pickle
import rhinoscriptsyntax as rs

localFolder = "\\".join(ghenv.Component.OnPingDocument().FilePath.split("\\")[:-1]) + "\\"

if screenshot:
    with open(localFolder + "meta.file", 'rb') as f:
        meta = pickle.load(f)
    
    jobID = meta['jobID']
    designID = meta['designID']
    
    imageFolder = localFolder + str(jobID) + "\\images\\"
    imageName = imageFolder + str(designID) + ".png"
    rs.Command("_-ViewCaptureToFile \n\"" + imageName + "\"\n _Enter")

outputFile = localFolder + "outputs.txt"

with open(outputFile, 'w') as f:
    f.write('\n'.join([str(x) for x in data]))

print "complete"
# ---------- end python_2 ----------
